# Grasshopper definition evolution-example.gh (Grasshopper 1.0.7)
# plug-ins: Pufferfish

# 1. Input Coordinates
number_slider = Slider(0, range=0..100)
number_slider_2 = Slider(20, range=0..100)
number_slider_3 = Slider(20, range=0..100)
number_slider_4 = Slider(0, range=0..100)
number_slider_5 = Slider(0, range=0..100)
number_slider_6 = Slider(0, range=0..100)
# A
A = ConstructPoint(XCoordinate=number_slider, YCoordinate=number_slider_2, ZCoordinate=0)
# B
B = ConstructPoint(XCoordinate=number_slider_3, YCoordinate=number_slider_5, ZCoordinate=0)
# C
C = ConstructPoint(XCoordinate=number_slider_4, YCoordinate=number_slider_6, ZCoordinate=0)
panel = Panel("""A
B
C""")
# 2. Make surface
pline = PolyLine(Vertices=[A, B, C], Closed=False)
# 4. Evolutionary solve
galapagos = Galapagos(fitness=area, gene=[number_slider, number_slider_2, number_slider_3, number_slider_5, number_slider_4, number_slider_6])
tag = TextTag3D(
    Location=[A, B, C],
    Text=panel,
    Size=Slider(7, range=0..100),
    Colour=ColourSwatch(SwatchColor=RGB(0, 0, 0)),
    Justification=7)
clscrv = CloseCurve(Curve=pline, CloseType=0, Bulge=0.5, Tolerance=0)  # -> Closed, R
boundary = BoundarySurfaces(Edges=flatten(clscrv.Closed))
area = Area(Geometry=boundary)  # -> Area, Centroid
# 3. Evaluate surface
panel_2 = Panel(area.Area)
